# Grasshopper definition main.gh (Grasshopper 0.9.76)
# plug-ins: Python Interpreter

# ---- group: Define
ros_topic_types = ROSTopicTypes({"String": "std_msgs/String", "Twist": "geometry_msgs/Twist"}, selected="String")
advertise = PythonScript()  # -> R
# ---------- advertise: Python ----------
import json


data = {
"op":"advertise",
"topic":Topic,
"type":Type
}

R = json.dumps(data)
# ---------- end advertise ----------

# ---- group: Publish
publish_string = PythonScript()  # -> R
# ---------- publish_string: Python ----------
import json


data = {
"op":"publish",
"topic":topic,
"msg":{
    "data":msg
}
}

R = json.dumps(data)
# ---------- end publish_string ----------
publish_twist = PythonScript()  # -> R
# ---------- publish_twist: Python ----------
import json


data = {
"op":"publish",
"topic":topic,
"msg":{
    "angular":{"x":(AX or 0), "y":(AY or 0), "z":(AZ or 0)},
    "linear":{"x":(LX or 0), "y":(LY or 0), "z":(LZ or 0)},
}
}

R = json.dumps(data)
# ---------- end publish_twist ----------

# ---- group: Parse
subscribe = Subscribe()  # -> R
# ---------- subscribe: Python ----------
import json


data = {
"op":"subscribe",
"topic":Topic
}

R = json.dumps(data)
# ---------- end subscribe ----------
parse_string = PythonScript()  # -> data
# ---------- parse_string: Python ----------
import json

try:
    jsonObj = json.loads(M)["msg"];
    
    data = jsonObj["data"]
except:
    data = None
# ---------- end parse_string ----------
parse_twist = PythonScript()  # -> LX, LY, LZ, AX, AY, AZ
# ---------- parse_twist: Python ----------
import json

try:
    jsonObj = json.loads(M)["msg"];
    
    LX = jsonObj["linear"]["x"]
    LY = jsonObj["linear"]["y"]
    LZ = jsonObj["linear"]["z"]
    
    AX = jsonObj["angular"]["x"]
    AY = jsonObj["angular"]["y"]
    AZ = jsonObj["angular"]["z"]
except:
    LX = None
    LY = None
    LZ = None
    
    AX = None
    AY = None
    AZ = None
# ---------- end parse_twist ----------
